# Grasshopper definition speckle_basic.gh (Grasshopper 1.0.7)
# plug-ins: Speckle 2

list = Accounts(
    {"No account selected": , "Account (shervinazadi93@gmail.com | https://speckle.xyz)": "8c7cf764dc"}, selected="Account (shervinazadi93@gmail.com | https://speckle.xyz)",
    selectedId="8c7cf764dc",
    selectedServer="https://speckle.xyz")
sget = StreamGet(StreamIDURL="5be382cdb7", Account=list)
mesh = Mesh(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)
demesh = DeconstructMesh(Mesh=mesh)  # -> Vertices, Faces, Colours, Normals
to_speckle = ToSpeckle(Data=mesh, selectedKitName="Objects")
panel = Panel(demesh.Faces)
panel_2 = Panel("Send")
panel_3 = Panel("Receive")
send = Send(
    Data=to_speckle,
    Stream=sget,
    AutoSend=False,
    BaseId="057384e8f263839198a436bf1acfbf35",
    CurrentComponentState="up_to_date",
    KitName="Objects",
    OutputWrappers="https://speckle.xyz\t5be382cdb7\t5a122b0085",
    UseDefaultCache=True)
receive = Receive(
    Stream=sget,
    AutoReceive=False,
    CurrentComponentState="up_to_date",
    KitName="Objects",
    LastInfoMessage="Shervin Azadi @ 2021-09-01T13:49:19.842Z: edited_mesh (id:a233f8e7d7)",
    ReceivedCommitId="a233f8e7d7",
    StreamWrapper="https://speckle.xyz/streams/5be382cdb7?u=8c7cf764dc")  # -> Data, Info
