# Grasshopper definition speckle_recieve_test.gh (Grasshopper 1.0.7)
# plug-ins: Speckle 2

list = Accounts(
    {"No account selected": , "Account (shervinazadi93@gmail.com | https://speckle.xyz)": "8c7cf764dc"}, selected="Account (shervinazadi93@gmail.com | https://speckle.xyz)",
    selectedId="8c7cf764dc",
    selectedServer="https://speckle.xyz")
slist = StreamList(Account=list, Limit=10)
item = ListItem(List=slist, Index=0, Wrap=True)
sget = StreamGet(StreamIDURL=item, Account=list)
panel = Panel(sget)
receive = Receive(
    Stream=sget,
    AutoReceive=False,
    CurrentComponentState="up_to_date",
    KitName="Objects",
    LastInfoMessage="Shervin Azadi @ 2021-07-16T12:58:59.000Z: new box (id:38ba8604a3)",
    ReceivedCommitId="38ba8604a3",
    StreamWrapper="https://speckle.xyz/streams/57dcde8da6?u=8c7cf764dc")  # -> Data, Info
to_native = ToNative(Base=receive.Data, selectedKitName="Objects")
