# Grasshopper definition speckle_test.gh (Grasshopper 1.0.7)
# plug-ins: Speckle 2

list = Accounts(
    {"No account selected": , "Account (shervinazadi93@gmail.com | https://speckle.xyz)": "8c7cf764dc"}, selected="Account (shervinazadi93@gmail.com | https://speckle.xyz)",
    selectedId="8c7cf764dc",
    selectedServer="https://speckle.xyz")
slist = StreamList(Account=list, Limit=10)
item = ListItem(List=slist, Index=0, Wrap=True)
mesh = Mesh(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)
sget = StreamGet(StreamIDURL=item, Account=list)
to_speckle = ToSpeckle(Data=mesh, selectedKitName="Objects")
panel = Panel("Receive")
panel_2 = Panel("Send")
send = Send(
    Data=to_speckle,
    Stream=sget,
    AutoSend=False,
    BaseId="a19ee6bfce10b00160840218a877b3c3",
    CurrentComponentState="up_to_date",
    KitName="Objects",
    OutputWrappers="https://speckle.xyz\t57dcde8da6\t298c7eda43",
    UseDefaultCache=True)
receive = Receive(
    Stream=sget,
    AutoReceive=False,
    CurrentComponentState="expired",
    KitName="Objects",
    LastInfoMessage="Shervin Azadi @ 2021-08-17T13:22:55.691Z: Pushed 2 elements from Grasshopper. (id:f982c69323)",
    ReceivedCommitId="f982c69323",
    StreamWrapper="https://speckle.xyz/streams/57dcde8da6?u=8c7cf764dc")  # -> Data, Info
to_native = ToNative(Base=receive.Data, selectedKitName="Objects")
